# Grasshopper definition FixBoundarySectorAngleSum_Test.gh (Grasshopper 1.0.7)
# plug-ins: Crane

panel = Panel("""0
0
0
0
0
0
0
0
0
0
0
0
0
0
0""")
panel_2 = Panel("""2,0,0
0,3,0
0,0,4""")
panel_3 = Panel("""1,0,0
0,1,0
0,0,1""")
mesh = Mesh(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)
mesh_2 = Mesh(mesh)
conmesh = ConstructMesh(Vertices=panel_3, Faces="T[0;1;2}")
conmesh_2 = ConstructMesh(Vertices=panel_2, Faces="T[0;1;2}")
series = Series(Start="0", Step=1, Count="15")
mesh_3 = Mesh(mesh)
demesh = DeconstructMesh(Mesh=mesh_3)  # -> Vertices, Faces, Colours, Normals
points = PointList(Points=demesh.Vertices, Size="1")
demesh_2 = DeconstructMesh(Mesh=mesh_2)  # -> Vertices, Faces, Colours, Normals
points_2 = PointList(Points=demesh_2.Vertices, Size="1")
panel_4 = Panel("""0
1
2""")
pdecon = Deconstruct(Point=demesh.Vertices)  # -> XComponent, YComponent, ZComponent
weave = Weave(Pattern=panel_4, Stream0=pdecon.XComponent, Stream1=pdecon.YComponent, Stream2=pdecon.ZComponent, NullGaps=False)
cmesh_from_mesh = CMeshFromMesh(Mesh=mesh_2)
equal_sv_dir = EqualSVDirection(CMesh=cmesh_from_mesh, Strength="1")
equal_boundary_sector_angle = EqualBoundarySectorAngle(FirstVertexIds="0", SecondVertexIds="1")
panel_5 = Panel("true")
panel_6 = Panel("""0
1
2""")
fix_area_sum = FixAreaSum(GoalArea="4", Stiffness="2")
fix_boundary_sector_angle = FixBoundarySectorAngle(VertexIds="0", GoalAngles="1")
fix_boundary_sector_angle_sum = FixBoundarySectorAngleSum(VertexIds=panel_6, GoalAngle="2")
replace = ReplaceItems(List=panel, Item="0.0000001", Indices=graft(series), Wrap=False)
addition = Addition(A=weave, B=replace)
item = ListItem(List=addition, Index=0, Wrap=True)  # -> Item, Item1, Item2
item_2 = ListItem(List=addition, Index="3", Wrap=True)  # -> Item, Item1, Item2
item_3 = ListItem(List=addition, Index="6", Wrap=True)  # -> Item, Item1, Item2
item_4 = ListItem(List=addition, Index="9", Wrap=True)  # -> Item, Item1, Item2
item_5 = ListItem(List=addition, Index="12", Wrap=True)  # -> Item, Item1, Item2
pt = ConstructPoint(XCoordinate=item.Item, YCoordinate=item.Item1, ZCoordinate=item.Item2)
panel_7 = Panel(pt)
pt_2 = ConstructPoint(XCoordinate=item_2.Item, YCoordinate=item_2.Item1, ZCoordinate=item_2.Item2)
pt_3 = ConstructPoint(XCoordinate=item_3.Item, YCoordinate=item_3.Item1, ZCoordinate=item_3.Item2)
pt_4 = ConstructPoint(XCoordinate=item_4.Item, YCoordinate=item_4.Item1, ZCoordinate=item_4.Item2)
pt_5 = ConstructPoint(XCoordinate=item_5.Item, YCoordinate=item_5.Item1, ZCoordinate=item_5.Item2)
merge = Merge(Data1=pt, Data2=pt_2, Data3=pt_3, Data4=pt_4, Data5=pt_5)
conmesh_3 = ConstructMesh(Vertices=merge, Faces=demesh.Faces)
flatten = FlattenTree(Tree=conmesh_3, Path="{0}")
merge_2 = Merge(Data1=mesh_3, Data2=flatten)
graft = GraftTree(Tree=merge_2, IncludeEmptyLists=True, IncludeNullItems=True)
medges = MeshEdges(Mesh=graft)  # -> NakedEdges, InteriorEdges, NonManifoldEdges
item_6 = ListItem(List=medges.NakedEdges, Index=0, Wrap=True)  # -> Item, Item1, Item2, Item3
facen = FaceNormals(Mesh=graft)  # -> Centers, Normals
merge_3 = Merge(Data1=item_6.Item, Data2=item_6.Item1)
item_7 = ListItem(List=medges.InteriorEdges, Index=0, Wrap=True)  # -> Item, Item1
merge_4 = Merge(Data1=item_6.Item2, Data2=item_6.Item3)
cmesh_from_mesh_2 = CMeshFromMesh(Mesh=graft)
item_8 = ListItem(List=facen.Centers, Index=0, Wrap=True)  # -> Item, Item1, Item2
fix_fold_angle = FixFoldAngle(CMesh=cmesh_from_mesh_2, Line=medges.InteriorEdges, FoldAngle="1", Strength="1", Tolerance=0.001)
fix_sv_dir = FixSVDirection(
    CMesh=cmesh_from_mesh_2,
    OriginalCMesh=cmesh_from_mesh_2,
    FacePoints=facen.Centers,
    OriginalFacePoints=facen.Centers,
    GoalAngle="0",
    Strength="1")
equal_edge_length = EqualEdgeLength(CMesh=cmesh_from_mesh_2, FirstLine=item_6.Item, SecondLine=item_6.Item3, LengthRatio="0.8")
equal_edge_length_sum = EqualEdgeLengthSum(CMesh=cmesh_from_mesh_2, FirstEdges=merge_3, SecondEdges=merge_4)
equal_fold_angle = EqualFoldAngle(CMesh=cmesh_from_mesh_2, SecondLine=item_7.Item, SecondLine_2=item_7.Item1, Strength=1, Tolerance=0.001)
static_solver = CraneStaticSolver(
    CMesh=cmesh_from_mesh_2,
    Constraints=fix_boundary_sector_angle_sum,
    NRIteration="0",
    CGNRIteration="0",
    Threshold=1e-13,
    Solve=True,
    IsRigidEdge="0",
    IsPanelFlat="0",
    IsFoldBlock="0",
    IsConstraint="1")  # -> CMesh, RigidOrigami, Residual, RVec, Jacobian
fix_area = FixArea(CMesh=cmesh_from_mesh_2, FaceCenter=item_8.Item2, GoalArea="4", Stiffness="2")
flatten_2 = FlattenTree(Tree=static_solver.RVec, Path="{0}")
panel_8 = Panel(flatten_2)
item_9 = ListItem(List=flatten_2, Index=0, Wrap=True)
cull_i = CullIndex(List=flatten_2, Indices="0", Wrap=True)
subtraction = Subtraction(A=item_9, B=cull_i)
merge_5 = Merge(Data1=subtraction)
panel_9 = Panel(subtraction)
panel_10 = Panel(static_solver.Jacobian)
subtraction_2 = Subtraction(A=subtraction)
division = Division(A=subtraction_2, B=2)
division_2 = Division(A=merge_5, B="0.0000001")
multiplication = Multiplication(A=division_2, B=-1)
panel_11 = Panel(multiplication)
