# Grasshopper definition FixDeformation_Test.gh (Grasshopper 1.0.7)
# plug-ins: Crane

panel = Panel("""0
0
0
0
0
0
0
0
0""")
panel_2 = Panel("""2,0,0
0,3,0
0,0,4""")
panel_3 = Panel("""1,0,0
0,1,0
0,0,1""")
mesh = Mesh(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)
conmesh = ConstructMesh(Vertices=panel_3, Faces="T[0;1;2}")
conmesh_2 = ConstructMesh(Vertices=panel_2, Faces="T[0;1;2}")
mesh_2 = Mesh(conmesh_2)
series = Series(Start="0", Step=1, Count="9")
mesh_3 = Mesh(conmesh)
demesh = DeconstructMesh(Mesh=mesh_3)  # -> Vertices, Faces, Colours, Normals
points = PointList(Points=demesh.Vertices, Size="1")
demesh_2 = DeconstructMesh(Mesh=mesh_2)  # -> Vertices, Faces, Colours, Normals
points_2 = PointList(Points=demesh_2.Vertices, Size="1")
pdecon = Deconstruct(Point=demesh.Vertices)  # -> XComponent, YComponent, ZComponent
panel_4 = Panel("""0
1
2""")
weave = Weave(Pattern=panel_4, Stream0=pdecon.XComponent, Stream1=pdecon.YComponent, Stream2=pdecon.ZComponent, NullGaps=False)
cmesh_from_mesh = CMeshFromMesh(Mesh=mesh_2)
facen = FaceNormals(Mesh=mesh_2)  # -> Centers, Normals
panel_5 = Panel("true")
replace = ReplaceItems(List=panel, Item="0.0000001", Indices=graft(series), Wrap=False)
addition = Addition(A=weave, B=replace)
item = ListItem(List=addition, Index=0, Wrap=True)  # -> Item, Item1, Item2
item_2 = ListItem(List=addition, Index="3", Wrap=True)  # -> Item, Item1, Item2
item_3 = ListItem(List=addition, Index="6", Wrap=True)  # -> Item, Item1, Item2
pt = ConstructPoint(XCoordinate=item.Item, YCoordinate=item.Item1, ZCoordinate=item.Item2)
panel_6 = Panel(pt)
pt_2 = ConstructPoint(XCoordinate=item_2.Item, YCoordinate=item_2.Item1, ZCoordinate=item_2.Item2)
pt_3 = ConstructPoint(XCoordinate=item_3.Item, YCoordinate=item_3.Item1, ZCoordinate=item_3.Item2)
merge = Merge(Data1=pt, Data2=pt_2, Data3=pt_3)
conmesh_3 = ConstructMesh(Vertices=merge, Faces=demesh.Faces)
flatten = FlattenTree(Tree=conmesh_3, Path="{0}")
merge_2 = Merge(Data1=mesh_3, Data2=flatten)
graft = GraftTree(Tree=merge_2, IncludeEmptyLists=True, IncludeNullItems=True)
cmesh_from_mesh_2 = CMeshFromMesh(Mesh=graft)
facen_2 = FaceNormals(Mesh=graft)  # -> Centers, Normals
fix_deformation = FixDeformation(
    CMesh=cmesh_from_mesh,
    OriginalCMesh=cmesh_from_mesh,
    FacePoints=facen_2.Centers,
    OriginalFacePoints=facen.Centers,
    Sigma1="5",
    Sigma2="2",
    Strength="1")
static_solver = CraneStaticSolver(
    CMesh=cmesh_from_mesh_2,
    Constraints=fix_deformation,
    NRIteration="0",
    CGNRIteration="0",
    Threshold=1e-13,
    Solve=True,
    IsRigidEdge="0",
    IsPanelFlat="0",
    IsFoldBlock="0",
    IsConstraint="1")  # -> CMesh, RigidOrigami, Residual, RVec, Jacobian
item_4 = ListItem(List=static_solver.RVec, Index="1", Wrap=True)  # -> Item, Item1, Item2
panel_7 = Panel(static_solver.RVec)
flatten_2 = FlattenTree(Tree=item_4.Item, Path="{0}")
flatten_3 = FlattenTree(Tree=item_4.Item1, Path="{0}")
flatten_4 = FlattenTree(Tree=item_4.Item2, Path="{0}")
item_5 = ListItem(List=flatten_2, Index=0, Wrap=True)
item_6 = ListItem(List=flatten_3, Index=0, Wrap=True)
item_7 = ListItem(List=flatten_4, Index=0, Wrap=True)
cull_i = CullIndex(List=flatten_2, Indices="0", Wrap=True)
cull_i_2 = CullIndex(List=flatten_3, Indices="0", Wrap=True)
cull_i_3 = CullIndex(List=flatten_4, Indices="0", Wrap=True)
subtraction = Subtraction(A=item_5, B=cull_i)
subtraction_2 = Subtraction(A=item_6, B=cull_i_2)
subtraction_3 = Subtraction(A=item_7, B=cull_i_3)
merge_3 = Merge(Data1=subtraction, Data2=subtraction_2, Data3=subtraction_3)
panel_8 = Panel(subtraction)
panel_9 = Panel(static_solver.Jacobian)
subtraction_4 = Subtraction(A=subtraction)
division = Division(A=subtraction_4, B=2)
division_2 = Division(A=merge_3, B="0.0000001")
multiplication = Multiplication(A=division_2, B=-1)
panel_10 = Panel(multiplication)
