# Grasshopper definition MiuraFoldingOnDoubleSurface.gh (Grasshopper 1.0.7)
# plug-ins: Crane

planesrf = PlaneSurface(Plane=PlaneXY(0, 0, 0), XSize=Domain(-10, 10), YSize=Domain(-10, 10))
number_slider = Slider(5, range=0..10)
offset = OffsetSurface(Surface=planesrf, Distance=Slider(3, range=0..3), Retrim=True)
miura_folding_on_double_surface_2 = MiuraFoldingOnDoubleSurface2(S1=offset, S2=planesrf, U=number_slider, V=number_slider, SlideParam=Slider(0.58, range=0..1))
develop_mesh = DevelopMesh(Mesh=miura_folding_on_double_surface_2)  # -> DevelopMesh, FaceTree
