# Grasshopper definition MeshVerticesPrecisonCheck.gh (Grasshopper 1.0.7)

mesh = Mesh(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)
c_script = CSharpScript(mesh=mesh)  # -> out; inputs mesh: Mesh
# ---------- c_script: C# ----------
    Print("UseDoublePrecisionVertices is " + mesh.Vertices.UseDoublePrecisionVertices.ToString());
    Print("mesh.Vertices.Point3dAt(0).X = " + mesh.Vertices.Point3dAt(0).X.ToString());
    mesh.Vertices.UseDoublePrecisionVertices = false;
    Print("UseDoublePrecisionVertices is " + mesh.Vertices.UseDoublePrecisionVertices.ToString());
    Print("mesh.Vertices.Point3dAt(0).X = " + mesh.Vertices.Point3dAt(0).X.ToString());
    mesh.Vertices.SetVertex(0, 1.01010101010101, 0, 0);
    Print("UseDoublePrecisionVertices is " + mesh.Vertices.UseDoublePrecisionVertices.ToString());
    Print("mesh.Vertices.Point3dAt(0).X = " + mesh.Vertices.Point3dAt(0).X.ToString());
    mesh.Vertices.UseDoublePrecisionVertices = true;
    mesh.Vertices.SetVertex(0, 1.01010101010101, 0, 0);
    Print("UseDoublePrecisionVertices is " + mesh.Vertices.UseDoublePrecisionVertices.ToString());
    Print("mesh.Vertices.Point3dAt(0).X = " + mesh.Vertices.Point3dAt(0).X.ToString());
    mesh.Vertices.Clear();
    mesh.Vertices.UseDoublePrecisionVertices = true;
    mesh.Vertices.AddVertices(new Point3d[]{new Point3d(1.01010101010101, 0, 0)});
    Print("UseDoublePrecisionVertices is " + mesh.Vertices.UseDoublePrecisionVertices.ToString());
    Print("mesh.Vertices.Point3dAt(0).X = " + mesh.Vertices.Point3dAt(0).X.ToString());
# ---------- end c_script ----------
panel = Panel(c_script)
